# Grasshopper definition GHCitySim.ghx (Grasshopper 0.9.76)
# plug-ins: Python Interpreter

ladybug = Ladybug_Ladybug()  # -> Vviiiiiiiiiizzz; plug-in component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
honeybee = Honeybee_Honeybee()  # -> Vviiiiiiiiiizzz; plug-in component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
number_slider = Slider(2, range=0..10)
panel = Panel("""0
1""")

# ---- group: Testing area (for Aymeric)
box = CenterBox(Base=PlaneXY(0, 0, 0), X=1, Y=1, Z=1)
brep = Brep(box)
bldgprograms = Honeybee_bldgPrograms({"Office": 0, "Retail": 1, "MidriseApartment": 2, "PrimarySchool": 3, "SecondarySchool": 4, "SmallHotel": 5, "LargeHotel": 6, "Hospital": 7, "Outpatient": 8, "Warehouse": 9, "SuperMarket": 10, "FullServiceRestaurant": 11, "QuickServiceRestaurant": 12}, selected="Office")
createhbsrfs = Honeybee_createHBSrfs(geometry=brep)  # -> readMe, simplify(HBSurface); plug-in component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
createhbzones = Honeybee_createHBZones(name="test", zoneProgram=bldgprograms, HBSurfaces=flatten(createhbsrfs.HBSurface), isConditioned=True)  # -> readMe, HBZone; plug-in component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
panel_2 = Panel("ASHRAE 189.1-2009 EXTROOF IEAD CLIMATEZONE 1")
setepzonecnstr = Honeybee_SetEPZoneConstruction(
    HBZone=createhbzones.HBZone,
    wallEPConstruction="ASHRAE 189.1-2009 EXTWALL MASS CLIMATEZONE 1",
    roofEPConstruction=panel_2,
    floorEPConstruction=panel_2,
    expFloorEPConstruction=panel_2)  # -> simplify(modifiedHBZone); plug-in component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
citysim_checkmaterials = CitySimCheckMaterials(HBZones=flatten(setepzonecnstr))  # -> out; inputs HBZones: list of Brep
# ---------- citysim_checkmaterials: Python ----------
#Extract material properties
#GH-Citysim working component


ghenv.Component.Name = "CitySim-CheckMaterials"
ghenv.Component.NickName = 'CitySim-CheckMaterials'
ghenv.Component.Message = 'WORKING COMPONENT'
ghenv.Component.IconDisplayMode = ghenv.Component.IconDisplayMode.application
ghenv.Component.Category = "Honeybee"
ghenv.Component.SubCategory = "09 | Energy | Energy"
#compatibleHBVersion = VER 0.0.56\nFEB_03_2016
#compatibleLBVersion = VER 0.0.59\nFEB_01_2015
ghenv.Component.AdditionalHelpFromDocStrings = "1"


import Rhino as rc
import scriptcontext as sc
import rhinoscriptsyntax as rs
import os
import System
import Grasshopper.Kernel as gh
import math
import shutil
import collections
import subprocess
import copy

rc.Runtime.HostUtils.DisplayOleAlerts(False)


    
lb_preparation = sc.sticky["ladybug_Preparation"]()
hb_reEvaluateHBZones= sc.sticky["honeybee_reEvaluateHBZones"]
hb_hive = sc.sticky["honeybee_Hive"]()
hb_EPScheduleAUX = sc.sticky["honeybee_EPScheduleAUX"]()
hb_EPPar = sc.sticky["honeybee_EPParameters"]()
    
#EPConstructions = sc.sticky ["honeybee_constructionLib"].keys()
       
def EPConstructionStr(constructionName):
        constructionData = None
        if constructionName in sc.sticky ["honeybee_constructionLib"].keys():
            constructionData = sc.sticky ["honeybee_constructionLib"][constructionName]
        
        if constructionData!=None:
            materials = []
            numberOfLayers = len(constructionData.keys())
            constructionStr = constructionData[0] + ",\n"
            # add the name
            constructionStr =  constructionStr + "  " + constructionName + ",   !- name\n"
            
            for layer in range(1, numberOfLayers):
                if layer < numberOfLayers-1:
                    constructionStr =  constructionStr + "  " + constructionData[layer][0] + ",   !- " +  constructionData[layer][1] + "\n"
                else:
                    constructionStr =  constructionStr + "  " + constructionData[layer][0] + ";   !- " +  constructionData[layer][1] + "\n\n"
                materials.append(constructionData[layer][0])
                
            return materials
        else:
            warning = "Failed to find " + constructionName + " in library."
            print warning
            ghenv.Component.AddRuntimeMessage(gh.GH_RuntimeMessageLevel.Warning, warning)
            return None, None

        
 
def getMaterialProperties(matName):
    if not sc.sticky["honeybee_release"]:
        print "You should first let Honeybee to fly..."
        w = gh.GH_RuntimeMessageLevel.Warning
        ghenv.Component.AddRuntimeMessage(w, "You should first let Honeybee to fly...")
        return -1

    try:
        if not sc.sticky['honeybee_release'].isCompatible(ghenv.Component): return -1
        if sc.sticky['honeybee_release'].isInputMissing(ghenv.Component): return -1
    except:
        warning = "You need a newer version of Honeybee to use this compoent." + \
        " Use updateHoneybee component to update userObjects.\n" + \
        "If you have already updated userObjects drag Honeybee_Honeybee component " + \
        "into canvas and try again."
        w = gh.GH_RuntimeMessageLevel.Warning
        ghenv.Component.AddRuntimeMessage(w, warning)
        return -1
    
    # get the constuction
    try:
        hb_EPMaterialAUX = sc.sticky["honeybee_EPMaterialAUX"]()
    except:
        msg = "Failed to load EP constructions!"
        ghenv.Component.AddRuntimeMessage(w, msg)
        return -1
    
    if sc.sticky.has_key("honeybee_materialLib"):
        result = hb_EPMaterialAUX.decomposeMaterial(matName.upper(), ghenv.Component)
        if result == -1:
            warning = "Failed to find " + matName + " in the Honeybee material library."
            print warning
            ghenv.Component.AddRuntimeMessage(gh.GH_RuntimeMessageLevel.Warning, warning)
        return result
        

    
# call the objects from the lib
thermalZonesPyClasses = hb_hive.callFromHoneybeeHive(_HBZones)
 

for zone in thermalZonesPyClasses:

        schedules = zone.getCurrentSchedules(True)
        loads = zone.getCurrentLoads(True)
             
        for srf in zone.surfaces:
            if srf.EPConstruction != None:
                srf.construction = srf.EPConstruction
                print 'ID', EPConstructions.index(srf.construction)
                materials = EPConstructionStr(srf.construction)
                print "Solar reflectivity : ",str(1-float(getMaterialProperties(materials[-1])[0][-2]))
                #print "\n"
# ---------- end citysim_checkmaterials ----------
panel_3 = Panel(citysim_checkmaterials)

# ----
brep_2 = Brep([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])
number_slider_2 = Slider(80, range=0..100)
item = ListItem(List=brep_2, Index=panel, Wrap=True)
custom_mesh_settings = SettingsCustom(
    StitchSeams=True,
    SimplePlanes=False,
    Refine=True,
    MinCount=0,
    MaxCount=0,
    AspectRatio=20,
    MaxDistance=0,
    MaxAngle=20,
    MinEdge=number_slider,
    MaxEdge=number_slider)
mesh = MeshBrep(Brep=item, Settings=custom_mesh_settings)
separatebynormal = Honeybee_SeparateByNormal(geometry=item, maxUpDecAngle=number_slider_2, maxDownDecAngle=number_slider_2)  # -> simplify(lookingUp), simplify(lookingDown), simplify(lookingSide); plug-in component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
exportladybug = Ladybug_ExportLadybug(components="*", targetFolder="C:\Users\peronato\Documents\GitHub\GHCitySim", export=Toggle(False))  # -> readMe; plug-in component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
faceb = FaceBoundaries(Mesh=mesh)  # -> simplify(Boundaries)
srf = Surface(faceb)
epnomassmat = Honeybee_EnergyPlusNoMassOpaqueMaterial(name="floor", R_Value=Slider(1, range=0..1), solAbsp=Slider(0.9, range=0..1))  # -> EPMaterial; plug-in component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
epnomassmat_2 = Honeybee_EnergyPlusNoMassOpaqueMaterial(name="roof", R_Value=Slider(1, range=0..1), solAbsp=Slider(0.3, range=0..1))  # -> EPMaterial; plug-in component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
createhbsrfs_2 = Honeybee_createHBSrfs(geometry=srf)  # -> readMe, simplify(HBSurface); plug-in component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
mass2zone = Honeybee_Masses2Zones(zoneMasses=flatten(item), isConditioned=True, maxRoofAngle=30, createHBZones=Toggle(True))  # -> readMe, HBZones; plug-in component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
tstat = TreeStatistics(Tree=srf)  # -> Paths, Length, Count
epnomassmat_3 = Honeybee_EnergyPlusNoMassOpaqueMaterial(name="facade", R_Value=Slider(1, range=0..1), solAbsp=Slider(0.9, range=0..1))  # -> EPMaterial; plug-in component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
epconstruction = Honeybee_EnergyPlusConstruction(name="customfloor", layer_1=epnomassmat)  # -> EPConstruction; plug-in component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
epconstruction_2 = Honeybee_EnergyPlusConstruction(name="customroof", layer_1=epnomassmat_2)  # -> EPConstruction; plug-in component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
panel_4 = Panel("ASHRAE 189.1-2009 EXTROOF IEAD CLIMATEZONE 2-5")
epconstruction_3 = Honeybee_EnergyPlusConstruction(name="customfacade", layer_1=epnomassmat_3)  # -> EPConstruction; plug-in component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
panel_5 = Panel("ASHRAE 189.1-2009 EXTROOF IEAD CLIMATEZONE 2-5")
createhbzones_2 = Honeybee_createHBZones(name=tstat.Paths, HBSurfaces=flatten(createhbsrfs_2.HBSurface), isConditioned=True)  # -> readMe, simplify(HBZone); plug-in component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
addtoeplibrary = Honeybee_AddToEnergyPlusLibrary(EPObject=[epconstruction_2, epconstruction, epconstruction_3], addToProjectLib=Toggle(False))  # -> readMe; plug-in component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
simplified_zones = Data(mass2zone.HBZones)
vertical = Panel("""10
10
10
10
10""")
horiziontal = Panel("""0
90
180
270
360""")
context = Brep([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])
terrain_mesh = Mesh(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)
callfromepconstrlibrary = Honeybee_CallFromEPConstructionLibrary()  # -> ThermMaterials, EPMaterials, EPWindowMaterials, EPConstructions; plug-in component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
smesh = SimpleMesh(Brep=context)
createhbsrfs_3 = Honeybee_createHBSrfs(geometry=separatebynormal.lookingUp, srfType=Slider(1, range=0..1), EPConstruction=panel_4)  # -> readMe, simplify(HBSurface); plug-in component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
createhbsrfs_4 = Honeybee_createHBSrfs(geometry=separatebynormal.lookingDown, srfType=Slider(2.5, range=0..10), EPConstruction=panel_4)  # -> readMe, simplify(HBSurface); plug-in component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
createhbsrfs_5 = Honeybee_createHBSrfs(geometry=separatebynormal.lookingSide, srfType=Slider(0, range=0..100), EPConstruction=panel_4)  # -> readMe, simplify(HBSurface); plug-in component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
path = FilePath("C:\Users\peronato\Desktop\CitySimGH\")
path_2 = FilePath(path)
path_3 = FilePath(path)
path_4 = FilePath(path)
setepzonecnstr_2 = Honeybee_SetEPZoneConstruction(
    HBZone=simplified_zones,
    wallEPConstruction=panel_5,
    roofEPConstruction=panel_5,
    floorEPConstruction=panel_5,
    expFloorEPConstruction=panel_5)  # -> simplify(modifiedHBZone); plug-in component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
callfromepconstrlibrary_2 = Honeybee_CallFromEPConstructionLibrary()  # -> ThermMaterials, EPMaterials, EPWindowMaterials, EPConstructions; plug-in component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
preview = CustomPreview(Geometry=terrain_mesh, Shader=ColourSwatch(SwatchColor=RGB(255, 255, 255)))
zones_with_detailed_mesh = Data(createhbzones_2.HBZone)
epw_path = FilePath("C:\Users\peronato\Documents\WeatherFiles\Neuchatel-hour.epw")
path_5 = FilePath(path)
panel_6 = Panel(callfromepconstrlibrary.EPConstructions)
panel_7 = Panel("""1
1
1
1
1
1
1
1
1
1
1
1
1
1
1
1
1
1
1
1
1
1
1
1""")
panel_8 = Panel("""1
1
1
1
1
1
1
0.5
0.5
0.5
1
1
1
1
1
1
1
1
1
1
1
1
1
1""")
epw_to_clim = Ladybug_EpwToClim(epwFile=epw_path, path=path_5, Run=Toggle(False))  # -> out, climatefile; plug-in component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
glazingcreator = Honeybee_GlazingBasedOnRatio(HBObjects=createhbsrfs_5.HBSurface, glzRatio=Slider(0.4, range=0..1), runIt=Toggle(True))  # -> readMe, HBObjWGLZ; plug-in component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
path_mapper = PathMapper(createhbsrfs_5.HBSurface, source=["{A}", "{A;B}", "{A;B;C}"], target=["{A}", "{A}", "{A}"])
path_mapper_2 = PathMapper(createhbsrfs_4.HBSurface, source=["{A}", "{A;B}", "{A;B;C}"], target=["{A}", "{A}", "{A}"])
path_mapper_3 = PathMapper(createhbsrfs_3.HBSurface, source=["{A}", "{A;B}", "{A;B;C}"], target=["{A}", "{A}", "{A}"])
panel_9 = Panel(callfromepconstrlibrary_2.EPConstructions)
crv = Curve(srf)
lng = ListLength(List=flatten(crv))
climate_file = Text(epw_to_clim.climatefile)
path_6 = FilePath(path)
clean = CleanTree(RemoveNulls=True, RemoveInvalid=True, RemoveEmpty=False, Tree=[path_mapper_3, path_mapper_2, path_mapper])
entwine = Entwine(Branch00=panel_7, Branch01=panel_8, FlattenInputs=True)  # -> simplify(Result)
name = Text("test")
name_2 = Text(name)
name_3 = Text(name)
name_4 = Text(name)
citysim_horizon = Honeybee_CitySimHorizon(H=horiziontal, V=vertical, path=path_4, name=name_4, Write=Toggle(False))  # -> out; plug-in component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
citysim_srf = Honeybee_CitySimSrf(S=smesh, R=Slider(0.2, range=0..1), path=path_3, name=name_3, Write=Toggle(False))  # -> out; plug-in component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
citysim_srf_2 = Honeybee_CitySimSrf(
    S=terrain_mesh,
    R=Slider(0.1, range=0..1),
    type="terrain",
    Dup=Toggle(False),
    path=path_2,
    name=name_2,
    Write=Toggle(False))  # -> out; plug-in component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
name_5 = Text(name)
dup = DuplicateData(Data=Slider(0.2, range=0..1), Number=lng, Order=True)
createhbzones_3 = Honeybee_createHBZones(name=simplify(graft(tstat.Paths)), HBSurfaces=clean, isConditioned=True)  # -> readMe, simplify(HBZone); plug-in component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
panel_10 = Panel("""0.4
0.5
1.0
0.0""")
panel_11 = Panel("""5
0""")
citysim_schedules = Honeybee_CitySimSchedules(path=path_6, day=entwine, name=name_5, Write=Toggle(False))  # -> out; plug-in component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
unflatten = UnflattenTree(Tree=dup, Guide=crv)
python = PythonScript(geometry=flatten(crv))  # -> out, a; inputs geometry: tree of Polyline
# ---------- python: Python ----------
# written by Giulio Piacentino, giulio@mcneel.com
def tree_to_list(input, retrieve_base = lambda x: x[0]):
    """Returns a list representation of a Grasshopper DataTree"""
    def extend_at(path, index, simple_input, rest_list):
        target = path[index]
        if len(rest_list) <= target: rest_list.extend([None]*(target-len(rest_list)+1))
        if index == path.Length - 1:
            rest_list[target] = list(simple_input)
        else:
            if rest_list[target] is None: rest_list[target] = []
            extend_at(path, index+1, simple_input, rest_list[target])
    all = []
    for i in range(input.BranchCount):
        path = input.Path(i)
        extend_at(path, 0, input.Branch(path), all)
    return retrieve_base(all)
    
geometry = tree_to_list(geometry, lambda x: x)



for b in xrange(len(geometry)):
    for s in xrange(len(geometry[b])):
        print b,s
        for p in xrange(geometry[b][s].Count):
            print geometry[b][s].X[p],geometry[b][s].Y[p],geometry[b][s].Z[p]
# ---------- end python ----------
zones_with_materials = Data(createhbzones_3.HBZone)
hbzones = Data(zones_with_materials)
toggle = BooleanToggle(False)
hbzones_2 = Data(hbzones)
path_7 = FilePath(path)
hbzones_3 = Data(hbzones)
climate_file_2 = Text(climate_file)
path_8 = FilePath(path)
climate_file_3 = Text(climate_file)
path_9 = FilePath(path)
runenergysimulation = Honeybee_RunEnergySimulation(epwFile=epw_path, HBZones=flatten(createhbzones_3.HBZone), writeIdf=toggle, runEnergyPlus=toggle)  # -> report, idfFileAddress, resultFileAddress, studyFolder; plug-in component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
citysim_loadresults = Honeybee_CitySimLoadResults(path=path_7, name=name, yearly=Toggle(False), HBZones=flatten(hbzones_2), Run=Toggle(True))  # -> SW, H, C, Surfaces; plug-in component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
citysim_runsimulation = Honeybee_CitySimRunSimulation(
    HBZones=flatten(hbzones_3),
    Windows=panel_10,
    Occupancy=panel_11,
    path=path_8,
    name=name,
    climatefile=climate_file_2,
    Solver="C:\CitySim.exe",
    Write=Toggle(False),
    Run=Toggle(False))  # -> out; plug-in component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

# ---- group: These components do not use HoneyBee zones: they are faster
citysim_loadsolar = Honeybee_CitySimLoadSolar(path=path_9, name="test-solar", geometry=crv, Run=Toggle(False))  # -> results; plug-in component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
citysim_solar = Honeybee_CitySimSolar(
    geometry=crv,
    reflectance=unflatten,
    path=path_9,
    name="test-solar",
    climatefile=climate_file_3,
    Solver="C:\CitySim.exe",
    Write=Toggle(False),
    Run=Toggle(False))  # -> out; plug-in component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

# ----
python_2 = PythonScript()  # -> Out, A
explode = Explode(Curve=citysim_loadresults.Surfaces, Recursive=True)  # -> Segments, simplify(Vertices)
srf_2 = Surface(citysim_loadresults.Surfaces)
lng_2 = ListLength(List=explode.Vertices)
equals = Equality(FirstNumber=lng_2, SecondNumber="5")  # -> simplify(Equality), Inequality
equals_2 = Equality(FirstNumber=lng_2, SecondNumber="4")  # -> simplify(Equality), Inequality
dup_2 = DuplicateData(Data=equals.Equality, Number=lng_2, Order=True)  # -> simplify(Data)
ma = MassAddition(Input=citysim_loadresults.SW)  # -> Result, PartialResults
dup_3 = DuplicateData(Data=equals_2.Equality, Number=lng_2, Order=True)  # -> simplify(Data)
dispatch = Dispatch(List=explode.Vertices, DispatchPattern=dup_2)  # -> ListA, ListB
dispatch_2 = Dispatch(List=explode.Vertices, DispatchPattern=dup_3)  # -> ListA, ListB
division = Division(A=ma.Result, B=1000)
clean_2 = CleanTree(RemoveNulls=True, RemoveInvalid=True, RemoveEmpty=True, Tree=dispatch.ListA)
clean_3 = CleanTree(RemoveNulls=True, RemoveInvalid=True, RemoveEmpty=True, Tree=dispatch_2.ListA)
bnd = Bounds(Numbers=flatten(division))
quad = MeshQuad(CornerA=0, CornerB=1, CornerC=2, CornerD=3)
triangle = MeshTriangle(CornerA=0, CornerB=1, CornerC=2)
dedomain = DeconstructDomain(Domain=bnd)  # -> Start, End
conmesh = ConstructMesh(Vertices=clean_2, Faces=quad)
conmesh_2 = ConstructMesh(Vertices=clean_3, Faces=triangle)
gradient = Gradient(
    LowerLimit=Slider(0, range=0..100),
    UpperLimit=Slider(857, range=0..1000),
    Parameter=division,
    stops=[0: RGB(0, 0, 255), 0.501: RGB(255, 255, 0), 1: RGB(255, 0, 0)])
mjoin = MeshJoin(Meshes=[conmesh_2, conmesh])
preview_2 = CustomPreview(Geometry=srf_2, Shader=gradient)
mcol = MeshColours(Mesh=simplify(mjoin), Colours=gradient)
